# Grasshopper definition generetor.gh (Grasshopper 1.0.7)
# Copyright: 2021
# Copyright: 2024-02-51

panel = Panel("""Lorem ipsum dolor sit amet, consectetur adipiscing elit, sed do eiusmod tempor incididunt ut labore et dolore magna aliqua. Eget nullam non nisi est. Lectus nulla at volutpat diam ut. Id nibh tortor id aliquet lectus proin nibh nisl condimentum. Egestas integer eget aliquet nibh praesent. Duis at consectetur lorem donec massa sapien. Accumsan tortor posuere ac ut consequat semper viverra nam. Tincidunt tortor aliquam nulla facilisi cras fermentum odio eu feugiat. Fermentum leo vel orci porta non pulvinar. Egestas sed sed risus pretium. Laoreet id donec ultrices tincidunt. Etiam dignissim diam quis enim lobortis. Ut porttitor leo a diam. Eget nunc scelerisque viverra mauris in aliquam. Est lorem ipsum dolor sit amet consectetur. Ornare suspendisse sed nisi lacus sed viverra tellus in. Ac turpis egestas integer eget. Felis donec et odio pellentesque diam volutpat commodo sed egestas. Urna neque viverra justo nec ultrices. Blandit turpis cursus in hac habitasse.
Eu scelerisque felis imperdiet proin fermentum. Facilisis sed odio morbi quis commodo odio aenean sed adipiscing. Gravida cum sociis natoque penatibus et magnis. Ridiculus mus mauris vitae ultricies leo integer malesuada. Integer enim neque volutpat ac tincidunt vitae. Ante in nibh mauris cursus mattis molestie a iaculis. Pellentesque elit ullamcorper dignissim cras tincidunt. Id porta nibh venenatis cras sed felis eget. Lorem ipsum dolor sit amet. Gravida rutrum quisque non tellus orci. Magna etiam tempor orci eu lobortis elementum nibh. Ut aliquam purus sit amet luctus venenatis lectus magna fringilla. Maecenas sed enim ut sem. Venenatis tellus in metus vulputate eu scelerisque felis imperdiet. Neque egestas congue quisque egestas diam in. Ut eu sem integer vitae justo eget magna fermentum.
Mattis ullamcorper velit sed ullamcorper morbi tincidunt ornare massa eget. Massa vitae tortor condimentum lacinia quis vel eros. Commodo quis imperdiet massa tincidunt nunc. Eget est lorem ipsum dolor. Eget magna fermentum iaculis eu non. Orci phasellus egestas tellus rutrum tellus pellentesque eu tincidunt tortor. Sed vulputate mi sit amet mauris. Eu turpis egestas pretium aenean pharetra magna. Massa tincidunt nunc pulvinar sapien et ligula ullamcorper malesuada. Semper viverra nam libero justo. Nullam non nisi est sit amet facilisis magna. Neque ornare aenean euismod elementum nisi quis.""")

cluster = Cluster()
cluster_2 = Cluster_2()
# fetch('http://localhost:3000/generate/', {
# 	method: 'POST',
# 	body: JSON.stringify({
# 		parts: [
# 			// {
# 			//     inline_data: {
# 			//         mime_type: 'image/png',
# 			//         data: 'MMtsdWMBaE2+8oBAucRX9mEXaRNW0MBGD7vKlrp6vRxsZ8lVvnrbNpf0gIqnwRyyQgIGVibUMEL6M4Wl8fP36UUBJFEgIcZ4drw4lNgRBFMVJKOPX',
# 			//     },
# 			// },
# 			{ text: 'What is the weather today?' },
# 		],
# 		completed: false,
# 	}),
# 	headers: {
# 		'Content-type': 'application/json; charset=UTF-8',
# 	},
# })
# 	.then((response) => response.json())
# 	.then((json) => console.log(json));
cluster_3 = Cluster_3()

reportenetor = GhPythonScript(Title="Demo report", Introduction=panel, steamID="3098147560", names=cluster_2, objects=cluster, text=cluster_3)  # -> text_out; inputs names: tree, objects: tree, text: tree
# ---------- reportenetor: Python ----------
__author__ = "mm1062"
__version__ = "2024.03.02"

import rhinoscriptsyntax as rs
import ghpythonlib.treehelpers as th
import scriptcontext as sc

text_out = ""

def add_header(text):
    global text_out
    text_out += '---\n'
    text_out += 'title: '+text+'\n'
    text_out += 'jupyter:\n'
    text_out += '  nbformat: 4\n'
    text_out += '  nbformat_minor: 5\n'
    text_out += '  kernelspec:\n'
    text_out += '     display_name: Python 2\n'
    text_out += '     language: python\n'
    text_out += '     name: python2\n'
    text_out += '  language_info:\n'
    text_out += '     codemirror_mode:\n'
    text_out += '       name: ipython\n'
    text_out += '       version: 2\n'
    text_out += '     file_extension: ".py"\n'
    text_out += '     mimetype: "text/x-python"\n'
    text_out += '     name: "python"\n'
    text_out += '     nbconvert_exporter: "python"\n'
    text_out += '     pygments_lexer: "ipython2"\n'
    text_out += '     version: "2.7.15"\n'
    text_out += '---\n'

def add_import():
    global text_out
    text_out += """
```code
%pip install specklepy
from specklepy.api.client import SpeckleClient
from specklepy.api.credentials import get_default_account
from specklepy.transports.server import ServerTransport
from specklepy.api import operations
```

"""

def add_title(text):
    global text_out
    text_out += "# " + text + "\n"
    text_out += "\n"

def add_introduction(text):
    global text_out
    text_out += text
    text_out += "\n"
    text_out += "\n"
    

def add_sub_title(text):
    global text_out
    text_out += "## " + text + "\n"
    text_out += "\n"

def add_text_block(text):
    global text_out
    text_out += text + "\n"
    text_out += "\n"

def add_speckle_ifram(objects, stream):
    global text_out
    
    text_out += '<iframe '
    text_out += 'src="https://speckle.xyz/embed?stream=' + stream 
    text_out += '&object=' + objects[0]
    
    if len(objects) > 1:
        text_out += '&overlay='
        
        sub_list = objects[1:] # Remaining items
        for idx, obj in enumerate(sub_list):
            text_out += obj
            if idx != len(sub_list)-1:
                text_out += "%2C"
        
    text_out += '&transparent=true'
    text_out += '&autoload=true'
    text_out += '&hidecontrols=true'
    text_out += '&hidesidebar=true" '
    text_out += 'width="600" height="400"'
    text_out += 'frameborder="0"'
    text_out += '></iframe>\n'
    text_out += "\n"



# Generate Report

add_header(Title)

add_import()

add_title(Title)

add_introduction(Introduction)

for name, objs, text in zip(names.Branches,objects.Branches,text.Branches):
    add_sub_title(name[0])
    add_speckle_ifram(objs, steamID)
    add_text_block(text[0])
# ---------- end reportenetor ----------
panel_2 = Panel(reportenetor)
file_path = FilePath("\\wsl.localhost\Arch\home\mephisto\repos\report+\generated.md")
write_file = GhPythonScript(path=file_path, text=reportenetor, save=Button())  # inputs save: Boolean
# ---------- write_file: Python ----------
__author__ = "mm1062"
__version__ = "2024.03.02"
        
import rhinoscriptsyntax as rs
import os
import sys

        
if save and path is not None and text is not None:
    with open(path, "w") as file:
        file.write(text)
# ---------- end write_file ----------

# ==== cluster Cluster
object_2 = Panel("""375782687fcb0a88d4977d1a74894cdd
1c20d069da3bd7357ac432ce3f439366
0a946e2f50ae925f1ff84fdf50b383db
142743dc3e8bf3e346dbabc326280b4e
27fff196094dfb11d1530766f7fd0ae0
63102bdac99fb3eb66de9937b089bd5a
f9dffb8b827860ec189579ad21204d05
219a56df29ba6ab95f9a3850fd0e993d
a75de32728522fe1d12320faac652077
010bff55488a77b1716ebd8f140a94fc
430d347c4ade38d072abe721ff076b34
83889959898c759c48a2f017df06e79f
4363b334bc53c2c6010ff3ee7583e9ed
e124af31b478e8d833474c32fb9822cf
b3e5de59ffab1ab6b47a91867e55e3b1
72be069c3477237f40bc10adaa73555a
75823507120fcf3a25b9d58c9738591a
2ed10f9db7b98ae80e8d7cf441bfbcb1
cc69debe5de052a156cee7fdae4fde43
7985096b8934fa829f2bb4477c5f7d54
5c67fdb82d83016c3ec63182e73c4316
d20c48bfe8eb1fe30e438cae7a8ba139
c685b351cb94c2bb77a19426b0cabd04
e1a42947dafa93156b8feeade6f70578
abdff6f793b52ecf8a65141c01ac1c0e
7f8201d52fd3b3c24fe4ea86ce28654a
7a2b112eddfba8e0f45a04dfbaac874b
c8fd9b3a453dac5346f546ce60fd1db9
e4ff1464847e7b053ee90e5b656893d0
cdbcdb2a5bf6b8862f5a38f3a53b39b8
eff473d6a1b827f033b320e6b0eba598""")
object_3 = Panel("""b77b1fbb3a3f49520c6740168d16bd11
e2f9e69fa2d38d01f5d92fedf6ad94fe
3921ddf10ad58600e42ab784c077196e
375782687fcb0a88d4977d1a74894cdd
1c20d069da3bd7357ac432ce3f439366
0a946e2f50ae925f1ff84fdf50b383db
142743dc3e8bf3e346dbabc326280b4e
27fff196094dfb11d1530766f7fd0ae0
63102bdac99fb3eb66de9937b089bd5a
f9dffb8b827860ec189579ad21204d05
219a56df29ba6ab95f9a3850fd0e993d
a75de32728522fe1d12320faac652077
010bff55488a77b1716ebd8f140a94fc
430d347c4ade38d072abe721ff076b34
83889959898c759c48a2f017df06e79f
4363b334bc53c2c6010ff3ee7583e9ed
e124af31b478e8d833474c32fb9822cf
b3e5de59ffab1ab6b47a91867e55e3b1
72be069c3477237f40bc10adaa73555a
75823507120fcf3a25b9d58c9738591a
2ed10f9db7b98ae80e8d7cf441bfbcb1
cc69debe5de052a156cee7fdae4fde43
7985096b8934fa829f2bb4477c5f7d54
5c67fdb82d83016c3ec63182e73c4316
d20c48bfe8eb1fe30e438cae7a8ba139
c685b351cb94c2bb77a19426b0cabd04
e1a42947dafa93156b8feeade6f70578
abdff6f793b52ecf8a65141c01ac1c0e
7f8201d52fd3b3c24fe4ea86ce28654a
7a2b112eddfba8e0f45a04dfbaac874b
c8fd9b3a453dac5346f546ce60fd1db9
e4ff1464847e7b053ee90e5b656893d0
cdbcdb2a5bf6b8862f5a38f3a53b39b8
eff473d6a1b827f033b320e6b0eba598""")
object_1 = Panel("""802376d6ee4e75030b632afc35cfee92
375782687fcb0a88d4977d1a74894cdd
1c20d069da3bd7357ac432ce3f439366
0a946e2f50ae925f1ff84fdf50b383db
142743dc3e8bf3e346dbabc326280b4e
27fff196094dfb11d1530766f7fd0ae0
63102bdac99fb3eb66de9937b089bd5a
f9dffb8b827860ec189579ad21204d05
219a56df29ba6ab95f9a3850fd0e993d
a75de32728522fe1d12320faac652077
010bff55488a77b1716ebd8f140a94fc
430d347c4ade38d072abe721ff076b34
83889959898c759c48a2f017df06e79f
4363b334bc53c2c6010ff3ee7583e9ed
e124af31b478e8d833474c32fb9822cf
b3e5de59ffab1ab6b47a91867e55e3b1
72be069c3477237f40bc10adaa73555a
75823507120fcf3a25b9d58c9738591a
2ed10f9db7b98ae80e8d7cf441bfbcb1
cc69debe5de052a156cee7fdae4fde43
7985096b8934fa829f2bb4477c5f7d54
5c67fdb82d83016c3ec63182e73c4316
d20c48bfe8eb1fe30e438cae7a8ba139
c685b351cb94c2bb77a19426b0cabd04
e1a42947dafa93156b8feeade6f70578
abdff6f793b52ecf8a65141c01ac1c0e
7f8201d52fd3b3c24fe4ea86ce28654a
7a2b112eddfba8e0f45a04dfbaac874b
c8fd9b3a453dac5346f546ce60fd1db9
e4ff1464847e7b053ee90e5b656893d0
cdbcdb2a5bf6b8862f5a38f3a53b39b8
eff473d6a1b827f033b320e6b0eba598""")
entwine = Entwine(Branch0X=object_1, Branch1X=object_2, Branch2X=object_3, FlattenInputs=False)  # -> simplify(Result)
result = ClusterOutput(entwine)

# ==== cluster Cluster_2
entwine = Entwine(Branch00="Object 1", Branch01="Object 2", Branch02="Object 3", FlattenInputs=True)  # -> simplify(Result)
result = ClusterOutput(entwine)

# ==== cluster Cluster_3
panel = Panel("Lorem ipsum dolor sit amet, consectetur adipiscing elit, sed do eiusmod tempor incididunt ut labore et dolore magna aliqua. Eget nullam non nisi est. Lectus nulla at volutpat diam ut. Id nibh tortor id aliquet lectus proin nibh nisl condimentum. Egestas integer eget aliquet nibh praesent. Duis at consectetur lorem donec massa sapien. Accumsan tortor posuere ac ut consequat semper viverra nam. Tincidunt tortor aliquam nulla facilisi cras fermentum odio eu feugiat. Fermentum leo vel orci porta non pulvinar. Egestas sed sed risus pretium. Laoreet id donec ultrices tincidunt. Etiam dignissim diam quis enim lobortis. Ut porttitor leo a diam. Eget nunc scelerisque viverra mauris in aliquam. Est lorem ipsum dolor sit amet consectetur. Ornare suspendisse sed nisi lacus sed viverra tellus in. Ac turpis egestas integer eget. Felis donec et odio pellentesque diam volutpat commodo sed egestas. Urna neque viverra justo nec ultrices. Blandit turpis cursus in hac habitasse.")
panel_2 = Panel("Lorem ipsum dolor sit amet, consectetur adipiscing elit, sed do eiusmod tempor incididunt ut labore et dolore magna aliqua. Eget nullam non nisi est. Lectus nulla at volutpat diam ut. Id nibh tortor id aliquet lectus proin nibh nisl condimentum. Egestas integer eget aliquet nibh praesent. Duis at consectetur lorem donec massa sapien. Accumsan tortor posuere ac ut consequat semper viverra nam. Tincidunt tortor aliquam nulla facilisi cras fermentum odio eu feugiat. Fermentum leo vel orci porta non pulvinar. Egestas sed sed risus pretium. Laoreet id donec ultrices tincidunt. Etiam dignissim diam quis enim lobortis. Ut porttitor leo a diam. Eget nunc scelerisque viverra mauris in aliquam. Est lorem ipsum dolor sit amet consectetur. Ornare suspendisse sed nisi lacus sed viverra tellus in. Ac turpis egestas integer eget. Felis donec et odio pellentesque diam volutpat commodo sed egestas. Urna neque viverra justo nec ultrices. Blandit turpis cursus in hac habitasse.")
panel_3 = Panel("Lorem ipsum dolor sit amet, consectetur adipiscing elit, sed do eiusmod tempor incididunt ut labore et dolore magna aliqua. Eget nullam non nisi est. Lectus nulla at volutpat diam ut. Id nibh tortor id aliquet lectus proin nibh nisl condimentum. Egestas integer eget aliquet nibh praesent. Duis at consectetur lorem donec massa sapien. Accumsan tortor posuere ac ut consequat semper viverra nam. Tincidunt tortor aliquam nulla facilisi cras fermentum odio eu feugiat. Fermentum leo vel orci porta non pulvinar. Egestas sed sed risus pretium. Laoreet id donec ultrices tincidunt. Etiam dignissim diam quis enim lobortis. Ut porttitor leo a diam. Eget nunc scelerisque viverra mauris in aliquam. Est lorem ipsum dolor sit amet consectetur. Ornare suspendisse sed nisi lacus sed viverra tellus in. Ac turpis egestas integer eget. Felis donec et odio pellentesque diam volutpat commodo sed egestas. Urna neque viverra justo nec ultrices. Blandit turpis cursus in hac habitasse.")
entwine = Entwine(Branch00=panel_2, Branch01=panel, Branch02=panel_3, FlattenInputs=True)  # -> simplify(Result)
result = ClusterOutput(entwine)
